test file "Transmission_Test_Suite"

suite "10-Speed Transmission Controller"

  case "ETRS 3" [baseline]
    model TransmissionControl, mode Normal, start time 0, stop time 65
    assessment "ETRS 3.1": At any point of time, whenever DriveRangeSelector == Park & VehicleSpeed <= 0.1 is true then, with no delay, GearCommanded == 0 must be true
      GearCommanded: signal TransmissionControl/Transmission Controller, port 2
      DriveRangeSelector: signal TransmissionControl/Variant Source2, port 1
      VehicleSpeed: signal TransmissionControl/LongitudinalVehiclePlant, port 3
      Park: expression RangeSelected.Park

  case "ETRS 4" [simulation]
    model TransmissionControl, variant configuration Test
    input "ETRS_0-60Log.mat", mapped to DriverBrake, DriverThrottle, DriverGearSelection (active)
    assessment "ETRS 4": At any point of time, if VehSpd > 0.1 becomes true then, with a delay of at most 12, VehSpd > 60 must be true
      VehSpd: signal TransmissionControl/Signal Specification, port 1

  case "TGA5_1_ThrottleIncreasing" [simulation]
    model TransmissionController, mode Normal, start time 0, stop time 10
    input "ThrottleShiftTest4.mat", mapped to DriverBrake, DriverThrottle, Driver Range Selection, Vehicle Speed, Engine Speed, EngPwrOutput (active)
    logged signals "Signal Set 1": DriverBrake, Vehicle Speed, Engine Speed, DriverThrottle, Driver Range Selection